% Simulink data dictionary appTaskRate.sldd

OUT_Toggler_B = Simulink.Signal(InitialValue="0", StorageClass="ExportToFile", HeaderFile="appTaskRate_Intfc.h", DefinitionFile="appTaskRate_Intfc.c", Owner="appTaskRate", DataType="boolean", Min=0, Max=1)